# Grasshopper definition 综合性能优化模型.gh (Grasshopper 1.0.7)
# plug-ins: RhinoCodePluginGH, Human, Wallacei

# ----
# 供冷/热设定温度
制冷温度下降 = Slider(0, range=0..10)
供暖温度上升 = Slider(0, range=0..10)

# ----
# 建筑模型_时间表与功率修正
# 优化前照明时间表
# 办公建筑
genes = GenePool(
    Decimals=2,
    Maximum=1,
    Minimum=0,
    Value=[0, 0, 0, 0, 0, 0, 0.08, 0.5, 0.95, 0.95, 0.95, 0.8, 0.8, 0.95, 0.95, 0.95, 0.95, 0.3, 0.3, 0, 0, 0, 0, 0])
genes_2 = GenePool(Decimals=2, Maximum=1, Minimum=0, Value=[0, 0, 0, 0, 0, 0, 0, 0, 0, 0, 0, 0, 0, 0, 0, 0, 0, 0, 0, 0, 0, 0, 0, 0])
weeklyschedule = HBWeeklySchedule(sun=genes_2, mon=genes, tue=genes, wed=genes, thu=genes, fri=genes, sat=genes_2, name="OL")  # -> report, schedule, idf_year, idf_week, idf_days; plug-in component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
# 通风时间表
genes_3 = GenePool(Decimals=2, Maximum=1, Minimum=0, Value=[0, 0, 0, 0, 0, 0, 0, 1, 1, 1, 1, 1, 1, 1, 1, 1, 1, 1, 1, 1, 0, 0, 0, 0])
genes_4 = GenePool(Decimals=2, Maximum=1, Minimum=0, Value=[0, 0, 0, 0, 0, 0, 0, 0, 0, 0, 0, 0, 0, 0, 0, 0, 0, 0, 0, 0, 0, 0, 0, 0])
weeklyschedule_2 = HBWeeklySchedule(sun=genes_4, mon=genes_3, tue=genes_3, wed=genes_3, thu=genes_3, fri=genes_3, sat=genes_4, name="OV")  # -> report, schedule, idf_year, idf_week, idf_days; plug-in component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
# 人员在室率
genes_5 = GenePool(
    Decimals=2,
    Maximum=1,
    Minimum=0,
    Value=[0, 0, 0, 0, 0, 0, 0, 0.1, 0.5, 0.95, 0.95, 0.95, 0.8, 0.8, 0.95, 0.95, 0.95, 0.95, 0.3, 0.3, 0, 0, 0, 0])
genes_6 = GenePool(Decimals=2, Maximum=1, Minimum=0, Value=[0, 0, 0, 0, 0, 0, 0, 0, 0.2, 0.45, 0, 0, 0, 0, 0, 0, 0, 0, 0, 0, 0, 0, 0, 0])
weeklyschedule_3 = HBWeeklySchedule(sun=genes_6, mon=genes_5, tue=genes_5, wed=genes_5, thu=genes_5, fri=genes_5, sat=genes_6, name="OP")  # -> report, schedule, idf_year, idf_week, idf_days; plug-in component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
# 设备时间表
genes_7 = GenePool(
    Decimals=2,
    Maximum=1,
    Minimum=0,
    Value=[0, 0, 0, 0, 0, 0, 0, 0.1, 0.5, 0.95, 0.95, 0.95, 0.5, 0.5, 0.95, 0.95, 0.95, 0.95, 0.3, 0.3, 0, 0, 0, 0])
genes_8 = GenePool(Decimals=2, Maximum=1, Minimum=0, Value=[0, 0, 0, 0, 0, 0, 0, 0, 0, 0, 0, 0, 0, 0, 0, 0, 0, 0, 0, 0, 0, 0, 0, 0])
weeklyschedule_4 = HBWeeklySchedule(sun=genes_8, mon=genes_7, tue=genes_7, wed=genes_7, thu=genes_7, fri=genes_7, sat=genes_8, name="OE")  # -> report, schedule, idf_year, idf_week, idf_days; plug-in component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
# 空调设定温度
genes_9 = GenePool(
    Decimals=0,
    Maximum=60,
    Minimum=0,
    Value=[60, 60, 60, 60, 60, 60, 28, 26, 26, 26, 26, 26, 26, 26, 26, 26, 26, 26, 60, 60, 60, 60, 60, 60])
genes_10 = GenePool(
    Decimals=0,
    Maximum=60,
    Minimum=0,
    Value=[60, 60, 60, 60, 60, 60, 60, 60, 60, 60, 60, 60, 60, 60, 60, 60, 60, 60, 60, 60, 60, 60, 60, 60])
subtraction = Subtraction(A=genes_9, B=制冷温度下降)
weeklyschedule_5 = HBWeeklySchedule(
    sun=genes_10,
    mon=subtraction,
    tue=subtraction,
    wed=subtraction,
    thu=subtraction,
    fri=subtraction,
    sat=genes_10,
    name="Occ",
    type_limit="Temperature")  # -> report, schedule, idf_year, idf_week, idf_days; plug-in component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
# 供暖设定温度
genes_11 = GenePool(
    Decimals=0,
    Maximum=20,
    Minimum=0,
    Value=[5, 5, 5, 5, 5, 12, 18, 20, 20, 20, 20, 20, 20, 20, 20, 20, 20, 20, 18, 12, 5, 5, 5, 5])
genes_12 = GenePool(Decimals=0, Maximum=5, Minimum=0, Value=[5, 5, 5, 5, 5, 5, 5, 5, 5, 5, 5, 5, 5, 5, 5, 5, 5, 5, 5, 5, 5, 5, 5, 5])
addition = Addition(A=genes_11, B=供暖温度上升)
weeklyschedule_6 = HBWeeklySchedule(
    sun=genes_12,
    mon=addition,
    tue=addition,
    wed=addition,
    thu=addition,
    fri=addition,
    sat=genes_12,
    name="Ohh",
    type_limit="Temperature")  # -> report, schedule, idf_year, idf_week, idf_days; plug-in component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
# 人员活动强度
genes_13 = GenePool(
    Decimals=0,
    Maximum=134,
    Minimum=0,
    Value=[134, 134, 134, 134, 134, 134, 134, 134, 134, 134, 134, 134, 134, 134, 134, 134, 134, 134, 134, 134, 134, 134, 134, 134])
# 能耗模拟
weeklyschedule_7 = HBWeeklySchedule(
    sun=genes_13,
    mon=genes_13,
    tue=genes_13,
    wed=genes_13,
    thu=genes_13,
    fri=genes_13,
    sat=genes_13,
    name="OA",
    type_limit="Activity Level")  # -> report, schedule, idf_year, idf_week, idf_days; plug-in component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

number_slider = Slider(0, range=0..1)
# 建筑类型
panel = Panel("办公建筑")
item = ListItem(List=[panel, "旅馆建筑"], Index=number_slider, Wrap=True)

# ----
# 几何参数化示例（根据实际设计而异）
窗墙比 = Slider(0.8, range=0.05..0.95)
层高 = Slider(4, range=3..5)
层数 = Slider(6, range=0..10)
长度 = Slider(16, range=16..54)
# 备注：
# Rhino 单位需要改成米
# 需要安装Ladybug1.8、Honeybee1.8和Wallacei
# 需要安装Ladybug legacy
# 需要安装OpenStudio最新版
# 需要安装Radiance
# 参数化几何建模
宽度 = Slider(16, range=16..54)
rectangle = Rectangle(Plane=PlaneXY(0, 0, 0), XSize=宽度, YSize=长度, Radius=0)  # -> Rectangle, Length
Z = UnitZ(Factor=层高)
extr = Extrude(Base=rectangle.Rectangle, Direction=Z)
arrlinear = LinearArray(Geometry=extr, Direction=Z, Count=层数)  # -> Geometry, Transform
debrep = DeconstructBrep(Brep=extr)  # -> Faces, Edges, Vertices
panel_2 = Panel("""0
1
2
3""")
item_2 = ListItem(List=debrep.Faces, Index=panel_2, Wrap=True)
area = Area(Geometry=item_2)  # -> Area, Centroid
scale = Scale(Geometry=item_2, Center=area.Centroid, Factor=窗墙比)  # -> Geometry, Transform
arrlinear_2 = LinearArray(Geometry=scale.Geometry, Direction=Z, Count=层数)  # -> Geometry, Transform

# ----
# 几何模型输入
panel_3 = Panel("""建筑体量
窗户平面
外遮阳
内遮阳""")
room = Geometry(arrlinear.Geometry)
window = Geometry(arrlinear_2.Geometry)
outdoor_shadings = Geometry()
indoor_shadings = Geometry()
sdiff = SolidDifference(BrepsA=room, BrepsB=window)

# ----
# 旅馆建筑
genes_14 = GenePool(
    Decimals=1,
    Maximum=1,
    Minimum=0,
    Value=[0.1, 0.1, 0.1, 0.1, 0.1, 0.1, 0.3, 0.3, 0.3, 0.3, 0.3, 0.3, 0.3, 0.3, 0.5, 0.5, 0.6, 0.9, 0.9, 0.9, 0.9, 0.8, 0.1, 0.1])
weeklyschedule_8 = HBWeeklySchedule(sun=genes_14, mon=genes_14, tue=genes_14, wed=genes_14, thu=genes_14, fri=genes_14, sat=genes_14, name="HL")  # -> report, schedule, idf_year, idf_week, idf_days; plug-in component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
genes_15 = GenePool(
    Decimals=0,
    Maximum=1,
    Minimum=0,
    Value=[0.7, 0.7, 0.7, 0.7, 0.7, 0.7, 0.7, 0.7, 1, 1, 1, 1, 1, 1, 1, 1, 1, 1, 0.7, 0.7, 0.7, 0.7, 0.7, 0.7])
weeklyschedule_9 = HBWeeklySchedule(sun=genes_15, mon=genes_15, tue=genes_15, wed=genes_15, thu=genes_15, fri=genes_15, sat=genes_15, name="HV")  # -> report, schedule, idf_year, idf_week, idf_days; plug-in component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
genes_16 = GenePool(
    Decimals=1,
    Maximum=1,
    Minimum=0,
    Value=[0.7, 0.7, 0.7, 0.7, 0.7, 0.7, 0.7, 0.7, 0.5, 0.5, 0.5, 0.5, 0.5, 0.5, 0.5, 0.5, 0.5, 0.5, 0.7, 0.7, 0.7, 0.7, 0.7, 0.7])
weeklyschedule_10 = HBWeeklySchedule(sun=genes_16, mon=genes_16, tue=genes_16, wed=genes_16, thu=genes_16, fri=genes_16, sat=genes_16, name="HP")  # -> report, schedule, idf_year, idf_week, idf_days; plug-in component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
genes_17 = GenePool(
    Decimals=1,
    Maximum=1,
    Minimum=0,
    Value=[0, 0, 0, 0, 0, 0, 0, 0, 0, 0, 0, 0, 0, 0, 0, 0, 0, 0.8, 0.8, 0.8, 0.8, 0.8, 0, 0])
weeklyschedule_11 = HBWeeklySchedule(sun=genes_17, mon=genes_17, tue=genes_17, wed=genes_17, thu=genes_17, fri=genes_17, sat=genes_17, name="HE")  # -> report, schedule, idf_year, idf_week, idf_days; plug-in component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
genes_18 = GenePool(
    Decimals=0,
    Maximum=26,
    Minimum=0,
    Value=[26, 26, 26, 26, 26, 26, 26, 26, 26, 26, 26, 26, 26, 26, 26, 26, 26, 26, 26, 26, 26, 26, 26, 26])
subtraction_2 = Subtraction(A=genes_18, B=制冷温度下降)
weeklyschedule_12 = HBWeeklySchedule(
    sun=subtraction_2,
    mon=subtraction_2,
    tue=subtraction_2,
    wed=subtraction_2,
    thu=subtraction_2,
    fri=subtraction_2,
    sat=subtraction_2,
    name="Hcc",
    type_limit="Temperature")  # -> report, schedule, idf_year, idf_week, idf_days; plug-in component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
genes_19 = GenePool(
    Decimals=0,
    Maximum=22,
    Minimum=0,
    Value=[22, 22, 22, 22, 22, 22, 22, 22, 22, 22, 22, 22, 22, 22, 22, 22, 22, 22, 22, 22, 22, 22, 22, 22])
addition_2 = Addition(A=genes_19, B=供暖温度上升)
weeklyschedule_13 = HBWeeklySchedule(
    sun=addition_2,
    mon=addition_2,
    tue=addition_2,
    wed=addition_2,
    thu=addition_2,
    fri=addition_2,
    sat=addition_2,
    name="Hhh",
    type_limit="Temperature")  # -> report, schedule, idf_year, idf_week, idf_days; plug-in component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

ladybug = Ladybug_Ladybug()  # -> Vviiiiiiiiiizzz; plug-in component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
honeybee = Honeybee_Honeybee()  # -> Vviiiiiiiiiizzz; plug-in component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

# ----
# 控制
# 运行控制台
toggle = BooleanToggle(False)
S = Script(
    toggle1=toggle,
    toggle2=Toggle(False),
    toggle3=Toggle(False),
    toggle4=Toggle(False),
    toggle5=Toggle(False),
    toggle6=Toggle(False),
    toggle7=Toggle(False),
    toggle8=Toggle(False),
    toggle9=Toggle(False),
    toggle10=Toggle(False))  # -> out, a, b, c, d, e, f, g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
# ---------- S: Python ----------
# 将每个 Toggle 的状态分配到独立的变量
a = toggle1
b = toggle2
c = toggle3
d = toggle4
e = toggle5
f = toggle6
g = toggle7
h = toggle8
i = toggle9
j = toggle10
# ---------- end S ----------
panel_4 = Panel(S.a)
panel_5 = Panel(S.b)
panel_6 = Panel(S.c)
panel_7 = Panel(S.d)
panel_8 = Panel(S.e)
panel_9 = Panel(S.f)
panel_10 = Panel(S.g)  # disabled
panel_11 = Panel(S.h)  # disabled
panel_12 = Panel(S.i)  # disabled
panel_13 = Panel(S.j)  # disabled

panel_14 = Panel("""能耗模拟
辐射模拟
发电计算
采光模拟
眩光模拟
析因实验""")

# ----
# 气象
# 中国气候分区气象数据
number_slider_2 = Slider(0, range=0..4)
path = FilePath("C:\Users\Administrator\Desktop\气象数据\CHN_YN_Kunming-Wujiaba.AP.567780_TMYx.2007-2021\CHN_YN_Kunming-Wujiaba.AP.567780_TMYx.2007-2021.epw")
path_2 = FilePath("C:\Users\asus\Desktop\CHN_GD_Guangzhou.592870_TMYx.2007-2021\CHN_GD_Guangzhou.592870_TMYx.2007-2021.epw")
path_3 = FilePath("C:\Users\Administrator\Desktop\气象数据\CHN_SH_Shanghai-Hongqiao.Intl.AP.583670_TMYx.2007-2021\CHN_SH_Shanghai-Hongqiao.Intl.AP.583670_TMYx.2007-2021.epw")
path_4 = FilePath("C:\Users\Administrator\Desktop\气象数据\CHN_Beijing.Beijing.545110_SWERA\CHN_Beijing.Beijing.545110_SWERA.epw")
path_5 = FilePath("C:\Users\Administrator\Desktop\气象数据\CHN_HL_Harbin.509530_TMYx.2007-2021\CHN_HL_Harbin.509530_TMYx.2007-2021.epw")
merge = Merge(Data1=path_2, Data2=path, Data3=path_3, Data4=path_4, Data5=path_5)
panel_15 = Panel("""广州
昆明
上海
北京
哈尔滨""")
item_3 = ListItem(List=merge, Index=number_slider_2, Wrap=True)
item_4 = ListItem(List=panel_15, Index=number_slider_2, Wrap=True)
panel_16 = Panel(item_4)
wea = HBWeaFromEPW(epw_file=item_3)  # -> wea; plug-in component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

# ----
# 建筑模型_构造+时间表预设
# 围护构造预设（可选）
# 时间表预设（可选）
number_slider_3 = Slider(2019, range=0..10000)
searchconstrset = HBSearchConstructionSets(keywords=number_slider_3)  # -> constr_sets; plug-in component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
searchprog = HBSearchPrograms(vintage=number_slider_3, keywords="Office")  # -> room_prog; plug-in component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
list = ItemSelector(
    searchprog,
    {"2019::College::Office", "2019::Courthouse::Office", "2019::HighriseApartment::Office", "2019::Hospital::HospitalOffice", "2019::Hospital::Office", "2019::Laboratory::Office", "2019::LargeOffice::Attic", "2019::LargeOffice::BreakRoom", "2019::LargeOffice::Classroom", "2019::LargeOffice::ClosedOffice"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}, selected="2019::MediumOffice::OpenOffice")
list_2 = ItemSelector(
    searchconstrset,
    {"2019::ClimateZone1::Mass", "2019::ClimateZone1::Metal Building", "2019::ClimateZone1::SteelFramed", "2019::ClimateZone1::WoodFramed", "2019::ClimateZone2::Mass", "2019::ClimateZone2::Metal Building", "2019::ClimateZone2::SteelFramed", "2019::ClimateZone2::WoodFramed", "2019::ClimateZone3::Mass", "2019::ClimateZone3::Metal Building"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}, selected="2019::ClimateZone3::SteelFramed")
roomsolid = HBRoomFromSolid(geo=flatten(room), name="Office", constr_set=list_2, program=list, conditioned=True)  # -> report, rooms; plug-in component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

# ----
# 光伏典型非透光外墙构造（外保温）
panel_17 = Panel("PV_Glass_6mm")
division = Division(A=Slider(6, range=0..10), B=1000)
division_2 = Division(A=Slider(1.52, range=0..10), B=1000)
opaquemat = HBOpaqueMaterial(
    name=panel_17,
    thickness=division,
    conductivity=Slider(1, range=0..1),
    density=Slider(2430, range=0..10000),
    spec_heat=Slider(840, range=0..1000))  # -> mat; plug-in component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
opaquemat_2 = HBOpaqueMaterial(
    name="PV_PVB_1.52mm",
    thickness=division_2,
    conductivity=Slider(0.2, range=0..1),
    density=Slider(1075, range=0..10000),
    spec_heat=Slider(1980, range=0..10000))  # -> mat; plug-in component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
panel_18 = Panel("""Generic Wall Air Gap
Generic Wall Air Gap
Typical Insulation-R14
8 in. Concrete Block Wall""")
merge_2 = Merge(Data1=opaquemat, Data2=opaquemat_2, Data3=opaquemat, Data4=panel_18)

# ----
# GB 55015-2021 外墙最低U值
panel_19 = Panel("Min_U-value")
gz_u_value = Slider(1.5, range=0..10)
bj_u_value = Slider(0.5, range=0..1)
km_u_value = Slider(1.5, range=0..10)
sh_u_value = Slider(0.8, range=0..1)
heb_u_value = Slider(0.35, range=0..1)
item_5 = ListItem(List=[gz_u_value, km_u_value, sh_u_value, bj_u_value, heb_u_value], Index=number_slider_2, Wrap=True)
one_over_x = OneOverX(Value=item_5)
opaquematnomass = HBOpaqueMaterialNoMass(name=panel_19, r_value=one_over_x, roughness="VerySmooth")  # -> mat; plug-in component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

# ----
# 绝热围护结构
panel_20 = Panel("Adiabatic")
# 采光_材料
number_slider_4 = Slider(1e-05, range=0..1e-05)
opaquematnomass_2 = HBOpaqueMaterialNoMass(
    name=panel_20,
    r_value=Slider(1000000, range=0..1000000),
    roughness="VerySmooth",
    therm_absp=number_slider_4,
    sol_absp=number_slider_4,
    vis_absp=number_slider_4)  # -> mat; plug-in component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

# ----
# 采光模拟：材质反射设置
panel_21 = Panel("Ecelling")
opaquemod = HBOpaqueModifier(name=panel_21, reflect=Slider(0.8, range=0..1))  # -> modifier; plug-in component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
opaquemod_2 = HBOpaqueModifier(name="Efloor", reflect=Slider(0.3, range=0..1))  # -> modifier; plug-in component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
opaquemod_3 = HBOpaqueModifier(name="Ewall", reflect=Slider(0.7, range=0..1))  # -> modifier; plug-in component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
interiorsubset = HBInteriorModifierSubset(interior_wall=opaquemod_3, ceiling=opaquemod, interior_floor=opaquemod_2)  # -> interior_set; plug-in component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
exteriorsubset = HBExteriorModifierSubset(exterior_wall=opaquemod_3)  # -> exterior_set; plug-in component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
modifierset = HBModifierSet(exterior_subset=exteriorsubset, interior_subset=interiorsubset)  # -> mod_set; plug-in component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

relay = Relay()

# ----
# 开窗方式1：窗墙比
# 开窗方式2：输入窗几何形状
toggle_2 = BooleanToggle(False)
relay_2 = Relay()
relay_3 = Relay()
aperture = HBAperture(geo=window, operable=toggle_2, ep_constr=relay_2, rad_mod=relay_3)  # -> report, apertures; plug-in component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
墙厚 = Panel("0.3")
aperturesbyratio = HBAperturesByRatio(hb_objs=flatten(relay), ratio=窗墙比)  # -> report, hb_objs; plug-in component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
bordershades = HBExtrudedBorderShades(hb_objs=flatten(aperture.apertures), depth=墙厚)  # -> report, hb_objs; plug-in component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
addsubface = HBAddSubface(hb_obj=flatten(roomsolid.rooms), sub_faces=flatten(bordershades.hb_objs))  # -> hb_obj; plug-in component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

# ----
# 采光模拟：遮阳反射设置
panel_22 = Panel("EShade")
# 建筑模型_几何开窗
number_slider_5 = Slider(0.8, range=0..1)
opaquemod_4 = HBOpaqueModifier(name=panel_22, reflect=Slider(0.7, range=0..1))  # -> modifier; plug-in component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
opaquemod_5 = HBOpaqueModifier(name="IShade", reflect=number_slider_5)  # -> modifier; plug-in component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
shade = HBShade(geo=outdoor_shadings, rad_mod=opaquemod_4)  # -> report, shades; plug-in component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
shade_2 = HBShade(geo=indoor_shadings, rad_mod=opaquemod_5)  # -> report, shades; plug-in component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

opaqueconstr = HBOpaqueConstruction(name="PV_Wall", materials=merge_2)  # -> constr; plug-in component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
opaqueconstr_2 = HBOpaqueConstruction(name="Regulation_Wall", materials=opaquematnomass)  # -> constr; plug-in component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
opaqueconstr_3 = HBOpaqueConstruction(name="Adiabatic_Envelope", materials=opaquematnomass_2)  # -> constr; plug-in component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
# 连接多个房间
solveadj = HBSolveAdjacency(rooms=flatten(addsubface), run=Toggle(True))  # -> report, adj_rooms; plug-in component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
item_6 = ListItem(List=[weeklyschedule_3.schedule, weeklyschedule_10.schedule], Index=number_slider, Wrap=True)
number_slider_6 = Slider(1, range=0..1)
colrange = LBColorRange(index="6")  # -> colors; plug-in component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
rev = ReverseList(List=colrange)
legendpar = LBLegendParameters(min=Slider(0, range=0..100), max=Slider(100, range=0..100))  # -> leg_par; plug-in component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
legendpar_2 = LBLegendParameters(min="50", max="100", colors=rev, num_decimals="0")  # -> leg_par; plug-in component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
toggle_3 = BooleanToggle(True)
# 进化算法优化
全国电网因子 = Slider(0.5703, range=0..1)

# ----
# 析因实验优化
# 需选取合适基因输入
fly = Ladybug_fly(fly=S.f)  # -> Vviiiiiiiiiizzz; inputs inputSliders: list, fly: Boolean; plug-in component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

number_slider_7 = Slider(30, range=0..100)

# ----
# 建筑光伏组件
# 物理性质数据库
# 数据库检索
# 能源强度和排放因子计算
# 物理性质计算
# 不透光光伏围护结构
id = Slider(21, range=1..97)
gtd = Slider(0, range=0..1)
S_2 = Script(num=id)  # -> out, a
# ---------- S_2: Python ----------
def format_number(num):
    """
    将输入的浮点数转换为整数，并格式化为3位字符串，不足3位时前面补零。
    """
    # 将输入的浮点数转换为整数
    num = int(num)
    
    if 0 <= num <= 999:
        return f"{num:03d}"  # 使用格式化字符串补零
    else:
        raise ValueError("输入的数字必须在0到999之间。")

# 尝试格式化 Slider 输入的 num 值
try:
    # 将格式化后的结果赋值给 Grasshopper 输出端口 'a'
    a = format_number(num)  # 'a' 是 Grasshopper 中的输出变量
except ValueError as e:
    a = str(e)  # 输出错误信息到端口 'a'
# ---------- end S_2 ----------
建筑光伏组件物理性质数据库 = Script()  # -> out, data
# ---------- 建筑光伏组件物理性质数据库: Python ----------
# 内置的组件数据
data = '''5+c+5, Group 1, 001, 5.374082901070143, 0.904, 0.838, 0.22688602211629985, 0.18784768725098397
6+c+6, Group 1, 002, 5.3169355957279585, 0.901, 0.833, 0.22852261803430274, 0.18699999999999997
8+c+8, Group 1, 003, 5.206211236361991, 0.896, 0.823, 0.23165869508558454, 0.1853308068605947
10+c+10, Group 1, 004, 5.100004434786466, 0.891, 0.813, 0.23460596206180656, 0.18365524770313862
12+c+12, Group 1, 005, 4.998044243556869, 0.886, 0.804, 0.23738642705560728, 0.18201246727634102
5+c+5c, Group 1, 006, 5.374082901070143, 0.864, 0.743, 0.22859342732486507, 0.17170173265933147
6+c+6c, Group 1, 007, 5.3169355957279585, 0.854, 0.724, 0.2303786007628288, 0.1679575007996273
8+c+8c, Group 1, 008, 5.206211236361991, 0.835, 0.69, 0.23361941973196443, 0.1608202149802802
10+c+10c, Group 1, 009, 5.100004434786466, 0.837, 0.694, 0.23602560300107417, 0.16142217075423299
12+c+12c, Group 1, 010, 4.998044243556869, 0.818, 0.665, 0.23872299904809685, 0.154610087834682
5+c+5+12Ar+5, Group 2, 011, 2.453, 0.828, 0.754, 0.10356211887621926, 0.187847687250984
6+c+6+12Ar+6, Group 2, 012, 2.418, 0.825, 0.747, 0.10392597022445038, 0.18699999999999997
8+c+8+12Ar+8, Group 2, 013, 2.4, 0.817, 0.734, 0.10679183824164472, 0.1853308068605947
10+c+10+12Ar+10, Group 2, 014, 2.366, 0.81, 0.721, 0.10883867128666037, 0.18365524770313862
12+c+12+12Ar+12, Group 2, 015, 2.332, 0.803, 0.71, 0.11076035363378776, 0.18201246727634102
5+c+5c+12Ar+5, Group 2, 016, 2.453, 0.78, 0.639, 0.10434146393912785, 0.17170173265933147
6+c+6c+12Ar+6, Group 2, 017, 2.435, 0.767, 0.616, 0.10550661800534442, 0.1679575007996273
8+c+8c+12Ar+8, Group 2, 018, 2.4, 0.743, 0.575, 0.1076957084339345, 0.1608202149802802
10+c+10c+12Ar+10, Group 2, 019, 2.366, 0.738, 0.574, 0.10949727276539573, 0.16142217075423299
12+c+12c+12Ar+12, Group 2, 020, 2.332, 0.713, 0.539, 0.11138397474128471, 0.1546100878346821
6+c+6+12Ar+6, Group 3, 021, 2.418, 0.825, 0.747, 0.10392597022445038, 0.18699999999999997
6+c+6+CES11-80+12Ar+6, Group 3, 022, 1.514, 0.723, 0.525, 0.065071927, 0.18699999999999997
6+c+6+CES11-70+12Ar+6, Group 3, 023, 1.459, 0.656, 0.458, 0.06270801925453809, 0.18699999999999997
6+c+6+SJ67+12Ar+6, Group 3, 024, 1.329, 0.65, 0.361, 0.05712060150053537, 0.18699999999999997
6+c+6+SJ60+12Ar+6, Group 3, 025, 1.297, 0.556, 0.305, 0.05574523713031932, 0.18699999999999997
6+c+6+SJ65+12Ar+6, Group 3, 026, 1.28, 0.634, 0.283, 0.055014574808642046, 0.18699999999999997
6+c+6+SJ50+12Ar+6, Group 3, 027, 1.288, 0.527, 0.232, 0.055358416, 0.18699999999999997
6+c+6+12Ar+6+12Ar+6, Group 4, 028, 1.58, 0.759, 0.682, 0.06790861577941754, 0.18699999999999997
6+c+6+CES11-80+12Ar+6+12Ar+6, Group 4, 029, 1.123, 0.663, 0.483, 0.04826669336726954, 0.18699999999999997
6+c+6+CES11-70+12Ar+6+12Ar+6, Group 4, 030, 1.092, 0.602, 0.421, 0.046934309133622745, 0.18699999999999997
6+c+6+SJ67+12Ar+6+12Ar+6, Group 4, 031, 1.014, 0.597, 0.333, 0.04358185848122112, 0.18699999999999997
6+c+6+SJ60+12Ar+6+12Ar+6, Group 4, 032, 0.994, 0.51, 0.281, 0.0427222557498361, 0.18699999999999997
6+c+6+SJ65+12Ar+6+12Ar+6, Group 4, 033, 0.984, 0.582, 0.261, 0.04229245438414357, 0.18699999999999997
6+c+6+SJ50+12Ar+6+12Ar+6, Group 4, 034, 0.989, 0.483, 0.213, 0.04250735506698983, 0.18699999999999997
6+c+6+12Ar+6+12Ar+6+6, Group 5, 035, 1.542, 0.752, 0.674, 0.06627537058978596, 0.18699999999999997
6+c+6+CES11-80+12Ar+6+12Ar+6+6, Group 5, 036, 1.103, 0.658, 0.48, 0.04740709063588451, 0.18699999999999997
6+c+6+CES11-70+12Ar+6+12Ar+6+6, Group 5, 037, 1.072, 0.596, 0.419, 0.04607470640223772, 0.18699999999999997
6+c+6+SJ67+12Ar+6+12Ar+6+6, Group 5, 038, 0.997, 0.592, 0.332, 0.042851196159543845, 0.18699999999999997
6+c+6+SJ60+12Ar+6+12Ar+6+6, Group 5, 039, 0.978, 0.505, 0.28, 0.04203457356472806, 0.18699999999999997
6+c+6+SJ65+12Ar+6+12Ar+6+6, Group 5, 040, 0.968, 0.577, 0.26, 0.041604772199035536, 0.18699999999999997
6+c+6+SJ50+12Ar+6+12Ar+6+6, Group 5, 041, 0.973, 0.479, 0.212, 0.041819672881881806, 0.18699999999999997
6+c+6+12Ar+6+CES11-80+12Ar+6, Group 6, 042, 1.088, 0.664, 0.518, 0.046762388587345737, 0.18699999999999997
6+c+6+CES11-80+12Ar+6+CES11-80+12Ar+6, Group 6, 043, 0.834, 0.581, 0.418, 0.03584543389875583, 0.18699999999999997
6+c+6+CES11-70+12Ar+6+CES11-80+12Ar+6, Group 6, 044, 0.815, 0.527, 0.37, 0.035028811303940054, 0.18699999999999997
6+c+6+SJ67+12Ar+6+CES11-80+12Ar+6, Group 6, 045, 0.767, 0.523, 0.307, 0.032965764748615976, 0.18699999999999997
6+c+6+SJ60+12Ar+6+CES11-80+12Ar+6, Group 6, 046, 0.755, 0.447, 0.26, 0.03245000310978495, 0.18699999999999997
6+c+6+SJ65+12Ar+6+CES11-80+12Ar+6, Group 6, 047, 0.748, 0.509, 0.245, 0.03214914215380019, 0.18699999999999997
6+c+6+SJ50+12Ar+6+CES11-80+12Ar+6, Group 6, 048, 0.751, 0.424, 0.199, 0.03227808256350795, 0.18699999999999997
6+c+6+12Ar+6+SJ60+12Ar+6, Group 7, 049, 0.949, 0.512, 0.321, 0.04078814960421977, 0.18699999999999997
6+c+6+CES11-80+12Ar+6+SJ60+12Ar+6, Group 7, 050, 0.739, 0.447, 0.3, 0.03176232092467693, 0.18699999999999997
6+c+6+CES11-70+12Ar+6+SJ60+12Ar+6, Group 7, 051, 0.673, 0.344, 0.214, 0.02892563191110633, 0.18699999999999997
6+c+6+SJ67+12Ar+6+SJ60+12Ar+6, Group 7, 052, 0.683, 0.403, 0.249, 0.02935543327679884, 0.18699999999999997
6+c+6+SJ60+12Ar+6+SJ60+12Ar+6, Group 7, 053, 0.673, 0.344, 0.214, 0.02892563191110633, 0.18699999999999997
6+c+6+SJ65+12Ar+6+SJ60+12Ar+6, Group 7, 054, 0.668, 0.393, 0.208, 0.028710731228260074, 0.18699999999999997
6+c+6+SJ50+12Ar+6+SJ60+12Ar+6, Group 7, 055, 0.67, 0.326, 0.17, 0.028796691501398575, 0.18699999999999997
6+c+6+12Ar+6+SJ50+12Ar+6, Group 8, 056, 0.943, 0.484, 0.255, 0.04053026878480426, 0.18699999999999997
6+c+6+CES11-80+12Ar+6+SJ50+12Ar+6, Group 8, 057, 0.735, 0.424, 0.256, 0.03159040037839993, 0.18699999999999997
6+c+6+CES11-70+12Ar+6+SJ50+12Ar+6, Group 8, 058, 0.719, 0.385, 0.236, 0.030902718193291896, 0.18699999999999997
6+c+6+SJ67+12Ar+6+SJ50+12Ar+6, Group 8, 059, 0.68, 0.382, 0.225, 0.029226492867091086, 0.18699999999999997
6+c+6+SJ60+12Ar+6+SJ50+12Ar+6, Group 8, 060, 0.67, 0.326, 0.195, 0.028796691501398575, 0.18699999999999997
6+c+6+SJ65+12Ar+6+SJ50+12Ar+6, Group 8, 061, 0.664, 0.372, 0.199, 0.02853881068198306, 0.18699999999999997
6+c+6+SJ50+12Ar+6+SJ50+12Ar+6, Group 8, 062, 0.667, 0.31, 0.165, 0.028667751091690816, 0.18699999999999997
6+c+6+12Ar+6, Group 9, 063, 2.418, 0.825, 0.747, 0.104, 0.187
6+PERCb+6+12Ar+6, Group 9, 064, 2.418, 0.825, 0.747, 0.09304142753422517, 0.1888
6+PERC+6+12Ar+6, Group 9, 065, 2.418, 0.825, 0.747, 0.0924891554888291, 0.1885
6+HIT-N+6+12Ar+6, Group 9, 066, 2.418, 0.825, 0.747, 0.09406556757284242, 0.1835
6+TOPCon+6+12Ar+6, Group 9, 067, 2.418, 0.825, 0.747, 0.09513473310470835, 0.1869
6+3.2TCO-CdTe+6+12Ar+6, Group 9, 068, 2.4, 0.756, 0.686, 0.092, 0.153
6+3.2+c+6, Group 10, 069, 5.212, 0.826, 0.777, 0.19872927037759536, 0.16
6+3.2+c+6+12Ar+6, Group 10, 070, 2.417, 0.756, 0.686, 0.09215822074110668, 0.16
6+3.2+c+6+CES11-80+12Ar+6, Group 10, 071, 1.505, 0.662, 0.488, 0.05738441134272468, 0.16
6+3.2+c+6+CES11-70+12Ar+6, Group 10, 072, 1.451, 0.601, 0.428, 0.055325435786241536, 0.16
6+3.2+c+6+SJ67+12Ar+6, Group 10, 073, 1.322, 0.596, 0.341, 0.05040677195686514, 0.16
6+3.2+c+6+SJ60+12Ar+6, Group 10, 074, 1.29, 0.509, 0.29, 0.04853844228524153, 0.16
6+3.2+c+6+SJ65+12Ar+6, Group 10, 075, 1.273, 0.581, 0.269, 0.04918663829376401, 0.16
6+3.2+c+6+SJ50+12Ar+6, Group 10, 076, 1.282, 0.483, 0.223, 0.04888160487798873, 0.16
6+12Ar+6+c+6, Group 11, 077, 2.405, 0.825, 0.789, 0.451058764685143, 0.163
6+12Ar+CES11-80+6+c+6, Group 11, 078, 1.506, 0.723, 0.666, 0.4505492058581307, 0.115
6+12Ar+CES11-70+6+c+6, Group 11, 079, 1.452, 0.656, 0.625, 0.42663216112613367, 0.0972
6+12Ar+SJ67+6+c+6, Group 11, 080, 1.324, 0.65, 0.504, 0.36806614992614695, 0.0754
6+12Ar+SJ60+6+c+6, Group 11, 081, 1.292, 0.556, 0.479, 0.3478334255119766, 0.0623
6+12Ar+SJ65+6+c+6, Group 11, 082, 1.276, 0.634, 0.409, 0.3160153060464476, 0.0569
6+12Ar+SJ50+6+c+6, Group 11, 083, 1.284, 0.527, 0.426, 0.3123078682379077, 0.0464
6+1Vacum+6+c+6, Group 12, 084, 2.115, 0.825, 0.792, 0.47400723138015066, 0.163
6+1Vacum+CES11-80+6+c+6, Group 12, 085, 0.875, 0.723, 0.682, 0.49260465697582506, 0.115
6+1Vacum+CES11-70+6+c+6, Group 12, 086, 0.794, 0.656, 0.643, 0.46699875538256824, 0.0972
6+1Vacum+SJ67+6+c+6, Group 12, 087, 0.595, 0.65, 0.52, 0.40573904464734645, 0.0754
6+1Vacum+SJ60+6+c+6, Group 12, 088, 0.543, 0.556, 0.499, 0.3844891117870368, 0.062299999999999994
6+1Vacum+SJ65+6+c+6, Group 12, 089, 0.5173, 0.634, 0.423, 0.3478670037612672, 0.0569
6+1Vacum+SJ50+6+c+6, Group 12, 090, 0.53, 0.527, 0.448, 0.3434492775206772, 0.0464
6+12Ar+6+3.2+c+6, Group 13, 091, 2.402, 0.755, 0.764, 0.42992419764316625, 0.13893886315653192
6+12Ar+CES11-80+6+3.2+c+6, Group 13, 092, 1.504, 0.662, 0.658, 0.4246629482402783, 0.11403549562447875
6+12Ar+CES11-70+6+3.2+c+6, Group 13, 093, 1.45, 0.601, 0.619, 0.40305921109288956, 0.10125987683084774
6+12Ar+SJ67+6+3.2+c+6, Group 13, 094, 1.322, 0.596, 0.5, 0.4090623787402556, 0.09338702737672526
6+12Ar+SJ60+6+3.2+c+6, Group 13, 095, 1.291, 0.509, 0.476, 0.40346143487795777, 0.07608941713620332
6+12Ar+SJ65+6+3.2+c+6, Group 13, 096, 1.274, 0.581, 0.406, 0.3809674200253241, 0.07871885504575814
6+12Ar+SJ50+6+3.2+c+6, Group 13, 097, 1.283, 0.483, 0.424, 0.35456624255872904, 0.05939868265720476'''
# ---------- end 建筑光伏组件物理性质数据库 ----------
建筑光伏组件物理性质数据库_2 = Script(data=建筑光伏组件物理性质数据库.data, id_query=S_2.a)  # -> out, name, group, id_code, U_value, VT, SHGC1, SHGC0, PCE
# ---------- 建筑光伏组件物理性质数据库_2: Python ----------
from typing import List, Dict, Any, Optional, Tuple


# 数据库条目类型定义
Component = Dict[str, Any]

# 解析 Panel 数据为数据库
def parse_data(data: str) -> List[Component]:
    database: List[Component] = []
    lines = data.strip().split('\n')
    for line in lines:
        fields = line.split(',')
        if len(fields) != 8:
            print(f"数据格式错误: {line}")
            continue  # 跳过格式错误的数据

        component = {
            '名称': fields[0].strip(),
            '组别': fields[1].strip(),
            '编号': fields[2].strip(),
            'U_value': float(fields[3].strip()),
            'VT': float(fields[4].strip()),
            'SHGC1': float(fields[5].strip()),
            'SHGC0': float(fields[6].strip()),
            'PCE': float(fields[7].strip())
        }
        database.append(component)
    return database

# 根据查询条件检索组件，并返回第一个匹配组件的所有数据
def search_component(
    database: List[Component], 
    name_query: Optional[str], 
    group_query: Optional[str], 
    id_query: Optional[str]
) -> Tuple[Optional[str], Optional[str], Optional[str], Optional[float], 
           Optional[float], Optional[float], Optional[float], Optional[float]]:
    
    for component in database:
        if (not name_query or component['名称'] == name_query) and \
           (not group_query or component['组别'] == group_query) and \
           (not id_query or component['编号'] == id_query):
            return (
                component['名称'],
                component['组别'],
                component['编号'],
                component['U_value'],
                component['VT'],
                component['SHGC1'],
                component['SHGC0'],
                component['PCE']
            )
    return (None, None, None, None, None, None, None, None)  # 未找到结果时返回空值

# 构建数据库并执行查询
database = parse_data(data)
name, group, id_code, U_value, VT, SHGC1, SHGC0, PCE = search_component(
    database, name_query, group_query, id_query
)

# 输出结果，确保每个字段正常显示
name = name if name else "未找到匹配项"
group = group if group else "未找到匹配项"
# ---------- end 建筑光伏组件物理性质数据库_2 ----------
panel_23 = Panel(建筑光伏组件物理性质数据库_2.group)
panel_24 = Panel(建筑光伏组件物理性质数据库_2.id_code)
panel_25 = Panel(建筑光伏组件物理性质数据库_2.U_value)
panel_26 = Panel(建筑光伏组件物理性质数据库_2.VT)
panel_27 = Panel(建筑光伏组件物理性质数据库_2.SHGC1)
panel_28 = Panel(建筑光伏组件物理性质数据库_2.SHGC0)
panel_29 = Panel(建筑光伏组件物理性质数据库_2.name)
panel_30 = Panel(建筑光伏组件物理性质数据库_2.PCE)
S_3 = Script(
    U=建筑光伏组件物理性质数据库_2.U_value,
    VT=建筑光伏组件物理性质数据库_2.VT,
    SHGC1=建筑光伏组件物理性质数据库_2.SHGC1,
    SHGC0=建筑光伏组件物理性质数据库_2.SHGC0,
    PCE=建筑光伏组件物理性质数据库_2.PCE,
    GTD=gtd)  # -> out, new_U, new_VT, new_SHGC, new_PCE
# ---------- S_3: Python ----------
# 计算函数：根据输入值进行计算
def calculate(U, VT, SHGC1, SHGC0, PCE, GTD):
    # 根据公式计算新值
    new_PCE = PCE * (1 - GTD)
    new_SHGC = SHGC1 * GTD + SHGC0 * (1 - GTD)
    new_VT = VT * GTD
    new_U = U  # U 保持不变

    # 返回计算结果
    return new_U, new_VT, new_SHGC, new_PCE

# 从 Grasshopper 组件输入值
new_U, new_VT, new_SHGC, new_PCE = calculate(U, VT, SHGC1, SHGC0, PCE, GTD)

# 输出计算结果
U_out = new_U
VT_out = new_VT
SHGC_out = new_SHGC
PCE_out = new_PCE
# ---------- end S_3 ----------
S_4 = Script(name=建筑光伏组件物理性质数据库_2.name, GTD=gtd, PCE=S_3.new_PCE)  # -> out, Fm, fm
# ---------- S_4: Python ----------
# 内置的表格数据
data = [
    {"cell_type": "cSi", "classification": "LG", "Fc": 150.8, "fc": 3310.2, 
     "Mg": 31.6416, "Fg": 2.54, "fg": 45.3, "Fw": 9.48, "fw": 137.89},
    {"cell_type": "cSi", "classification": "HG", "Fc": 150.8, "fc": 3310.2, 
     "Mg": 46.66, "Fg": 3.13, "fg": 45.3, "Fw": 9.48, "fw": 137.89},
    {"cell_type": "cSi", "classification": "DG", "Fc": 150.8, "fc": 3310.2, 
     "Mg": 61.6784, "Fg": 3.13, "fg": 45.3, "Fw": 9.48, "fw": 137.89},
    {"cell_type": "CdTe", "classification": "LG", "Fc": 42.6, "fc": 752.1, 
     "Mg": 24.2832, "Fg": 2.54, "fg": 45.3, "Fw": 13.2, "fw": 189.79},
    {"cell_type": "CdTe", "classification": "HG", "Fc": 42.6, "fc": 752.1, 
     "Mg": 39.3046, "Fg": 3.13, "fg": 45.3, "Fw": 13.2, "fw": 189.79}
]

# 判断光伏板名称的类型
def classify_name(name: str) -> (str, str):
    # 判断 cell_type：如果 name 中包含 '3.2'，则为 'CdTe'，否则为 'cSi'
    cell_type = "CdTe" if "3.2" in name else "cSi"

    # 根据 '+' 的数量确定 classification
    plus_count = name.count('+')
    if plus_count in [2, 3]:
        classification = "LG"
    elif plus_count in [4, 5]:
        classification = "HG"
    elif plus_count in [6, 7, 8, 9, 10, 11]:
        classification = "DG"
    else:
        classification = "error"

    return cell_type, classification

# 获取光伏板的参数
def get_factors(cell_type, classification):
    for row in data:
        if row["cell_type"] == cell_type and row["classification"] == classification:
            return row["Fc"], row["fc"], row["Mg"], row["Fg"], row["fg"], row["Fw"], row["fw"]
    raise ValueError(f"未找到匹配的 cell_type: {cell_type} 和 classification: {classification}。")

# 计算 Fm 和 fm
def calculate_fm_fm(PCE, GTD, name):
    # 通过 name 确定 cell_type 和 classification
    cell_type, classification = classify_name(name)

    if classification == "error":
        raise ValueError("名称中的 '+' 号数量不符合分类标准。")

    Fc, fc, Mg, Fg, fg, Fw, fw = get_factors(cell_type, classification)

    # Fm 和 fm 的计算公式
    Fm = (1 - GTD) * Fc + Mg * Fg + (1 - GTD) * PCE * 124 + Fw
    fm = (1 - GTD) * fc + Mg * fg + (1 - GTD) * PCE * 2290 + fw

    return Fm, fm

# Grasshopper 中从输入端口读取参数
try:
    # 在 Grasshopper 中定义 PCE、GTD 和 name 作为输入
    Fm, fm = calculate_fm_fm(PCE, GTD, name)
    # 输出结果到 Grasshopper
    print(f"Fm: {Fm}, fm: {fm}")
except ValueError as e:
    print(f"错误: {e}")
# ---------- end S_4 ----------
panel_31 = Panel(S_3.new_U)
panel_32 = Panel(S_3.new_VT)
panel_33 = Panel(S_3.new_SHGC)
panel_34 = Panel(S_3.new_PCE)

S_5 = Script(name=建筑光伏组件物理性质数据库_2.name)  # -> out, lowE
# ---------- S_5: Python ----------
def check_name_contains(name):
    """
    检查输入的 name 是否包含指定的关键词。
    """
    keywords = ["CES11-80", "CES11-70", "SJ67", "SJ60", "SJ65", "SJ50"]
    
    # 判断 name 中是否包含任何一个关键词
    for keyword in keywords:
        if keyword in name:
            return True  # 如果找到匹配项，返回 True
    return False  # 如果没有匹配项，返回 False

# 将结果输出到 Grasshopper
lowE = check_name_contains(name)  # 'name' 为输入的字符串，'a' 为输出的布尔值
# ---------- end S_5 ----------
S_6 = Script(lowE=S_5.lowE, Fm=S_4.Fm, fm=S_4.fm)  # -> out, Fm, fm
# ---------- S_6: Python ----------
# 设置默认值
default_Fg_lowE = 26.5962
default_fg_lowE = 595.3816

# 检查是否有输入值，否则使用默认值
Fg_lowE = Fg_lowE if Fg_lowE is not None else default_Fg_lowE
fg_lowE = fg_lowE if fg_lowE is not None else default_fg_lowE

# 检查 Fm 和 fm 是否有输入值，否则使用 0.0 作为初始值
Fm = Fm if Fm is not None else 0.0
fm = fm if fm is not None else 0.0

# 根据 Toggle 的状态调整 Fm 和 fm
if lowE:
    Fm += Fg_lowE
    fm += fg_lowE

# 将结果输出到 Grasshopper
Fm = Fm  # 输出调整后的 Fm
fm = fm  # 输出调整后的 fm
# ---------- end S_6 ----------

panel_35 = Panel(S_6.fm)
panel_36 = Panel(S_6.Fm)

# ----
# 建筑光伏组件
# 物理性质数据库
# 数据库检索
# 能源强度和排放因子计算
# 物理性质计算
# 透光光伏围护结构
id_2 = Slider(21, range=1..97)
gtd_2 = Slider(0, range=0..1)
S_7 = Script(num=id_2)  # -> out, a; same code as S_2
# 组件
建筑光伏组件物理性质数据库_3 = Script()  # -> out, data; same code as 建筑光伏组件物理性质数据库
建筑光伏组件物理性质数据库_4 = Script(data=建筑光伏组件物理性质数据库_3.data, id_query=S_7.a)  # -> out, name, group, id_code, U_value, VT, SHGC1, SHGC0, PCE; same code as 建筑光伏组件物理性质数据库_2
panel_37 = Panel(建筑光伏组件物理性质数据库_4.id_code)
panel_38 = Panel(建筑光伏组件物理性质数据库_4.U_value)
panel_39 = Panel(建筑光伏组件物理性质数据库_4.VT)
panel_40 = Panel(建筑光伏组件物理性质数据库_4.SHGC1)
panel_41 = Panel(建筑光伏组件物理性质数据库_4.SHGC0)
panel_42 = Panel(建筑光伏组件物理性质数据库_4.name)
panel_43 = Panel(建筑光伏组件物理性质数据库_4.group)
panel_44 = Panel(建筑光伏组件物理性质数据库_4.PCE)
S_8 = Script(
    U=建筑光伏组件物理性质数据库_4.U_value,
    VT=建筑光伏组件物理性质数据库_4.VT,
    SHGC1=建筑光伏组件物理性质数据库_4.SHGC1,
    SHGC0=建筑光伏组件物理性质数据库_4.SHGC0,
    PCE=建筑光伏组件物理性质数据库_4.PCE,
    GTD=gtd_2)  # -> out, new_U, new_VT, new_SHGC, new_PCE; same code as S_3
S_9 = Script(name=建筑光伏组件物理性质数据库_4.name, GTD=gtd_2, PCE=S_8.new_PCE)  # -> out, Fm, fm; same code as S_4
panel_45 = Panel(S_8.new_U)
panel_46 = Panel(S_8.new_SHGC)
panel_47 = Panel(S_8.new_PCE)
panel_48 = Panel(S_8.new_VT)

S_10 = Script(name=建筑光伏组件物理性质数据库_4.name)  # -> out, lowE; same code as S_5
S_11 = Script(lowE=S_10.lowE, Fm=S_9.Fm, fm=S_9.fm)  # -> out, Fm, fm; same code as S_6

panel_49 = Panel(S_11.fm)
panel_50 = Panel(S_11.Fm)

# ----
# 光伏幕墙构造
panel_51 = Panel("10.7")
# 能耗_构造
panel_52 = Panel("Aluminum alloy frame")
windowframe = HBWindowFrame(name=panel_52, width="0.04", conductance=panel_51)  # -> frame; plug-in component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
windowmat = HBWindowMaterial(name="PV_Glass_1", u_factor=S_8.new_U, shgc=S_8.new_SHGC, t_vis=S_8.new_VT)  # -> mat; plug-in component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
windowmat_2 = HBWindowMaterial(name="Reference_Glass_1", u_factor=建筑光伏组件物理性质数据库_4.U_value, shgc=建筑光伏组件物理性质数据库_4.SHGC1, t_vis=建筑光伏组件物理性质数据库_4.VT)  # -> mat; plug-in component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

# ----
# 采光模拟：玻璃透光设置
glassmod = HBGlassModifier(trans=S_8.new_VT)  # -> modifier; plug-in component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

windowconstr = HBWindowConstruction(name="PV_Window_1", materials=windowmat, frame=windowframe)  # -> constr; plug-in component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
windowconstr_2 = HBWindowConstruction(name="Reference_Window_1", materials=windowmat_2, frame=windowframe)  # -> constr; plug-in component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

# ----
# 建筑模型_构造修正
# 能耗：墙体构造设置
# 能耗：窗户构造设置
# 采光：窗户透光设置
# 采光：遮阳反射设置
# 内外遮阳（可选）
applyopaqueconstr = HBApplyOpaqueConstruction(hb_objs=flatten(solveadj.adj_rooms), constr=opaqueconstr)  # -> hb_objs; plug-in component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
applywindowconstr = HBApplyWindowConstruction(hb_objs=flatten(applyopaqueconstr), constr=windowconstr)  # -> hb_objs; plug-in component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
applywindowmod = HBApplyWindowModifier(hb_objs=flatten(applywindowconstr), mod=glassmod)  # -> hb_objs; plug-in component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
applymodset = HBApplyModifierSet(rooms=applywindowmod, mod_set=modifierset)  # -> rooms; plug-in component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
addshade = HBAddShade(hb_obj=applymodset, out_shades=flatten(shade.shades), in_shades=flatten(shade_2.shades))  # -> hb_obj; plug-in component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

# ----
# 划分网格
number_slider_8 = Slider(0.8, range=0..1)
# 采光模拟
panel_53 = Panel("daylighting")
model = HBModel(rooms=flatten(applymodset), name=panel_53)  # -> report, model; plug-in component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
gridrooms = HBSensorGridFromRooms(rooms=applymodset, grid_size="0.5", dist_floor=number_slider_8)  # -> grid, points, mesh; plug-in component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
assigngridsviews = HBAssignGridsAndViews(model=model.model, grids=flatten(gridrooms.grid))  # -> model; plug-in component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

# ----
# 建筑表面太阳辐射量模拟
number_slider_9 = Slider(4, range=0..10)
number_slider_10 = Slider(0.01, range=0..0.01)
# 辐射模拟
face = HBFace(geo=window)  # -> report, faces; plug-in component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
face_2 = HBFace(geo=sdiff)  # -> report, faces; plug-in component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
model_2 = HBModel(rooms=flatten(applymodset))  # -> report, model; plug-in component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
gridfaces = HBSensorGridFromFaces(hb_objs=face.faces, grid_size="0.5", offset=number_slider_10, face_type=number_slider_9)  # -> grid, points, mesh; plug-in component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
gridfaces_2 = HBSensorGridFromFaces(hb_objs=face_2.faces, grid_size="0.5", offset=number_slider_10, face_type=number_slider_9)  # -> grid, points, mesh; plug-in component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
merge_3 = Merge(Data1=gridfaces.mesh, Data2=gridfaces_2.mesh)
assigngridsviews_2 = HBAssignGridsAndViews(model=model_2.model, grids=flatten([gridfaces.grid, gridfaces_2.grid]))  # -> model; plug-in component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
mjoin = MeshJoin(Meshes=merge_3)
cumulativeradiation = HBCumulativeRadiation(model=assigngridsviews_2, wea=wea, run=S.b)  # -> report, avg_irr, radiation; plug-in component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
number_slider_11 = Slider(500, range=0..1000)
bang = ExplodeTree(Data=cumulativeradiation.radiation)  # -> Branch0, Branch1
meshselector = LBMeshThresholdSelector(values=bang.Branch0, mesh=gridfaces.mesh, abs_threshold=number_slider_11)  # -> report, total_value, total_area, sub_mesh, outline; plug-in component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
meshselector_2 = LBMeshThresholdSelector(values=bang.Branch1, mesh=gridfaces_2.mesh, abs_threshold=number_slider_11)  # -> report, total_value, total_area, sub_mesh, outline; plug-in component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
panel_54 = Panel(meshselector.total_area)
panel_55 = Panel(meshselector.total_value)
panel_56 = Panel(meshselector_2.total_value)
panel_57 = Panel(meshselector_2.total_area)
explode = ExplodeObject(Object=meshselector.sub_mesh, Recursive=False)
explode_2 = ExplodeObject(Object=meshselector_2.sub_mesh, Recursive=False)
subdmesh = SubDFromMesh(Mesh=explode, Creases=1, Corners=1, Interpolate=False)
subdmesh_2 = SubDFromMesh(Mesh=explode_2, Creases=1, Corners=1, Interpolate=False)
division_3 = Division(A=panel_55, B=panel_54)
division_4 = Division(A=panel_56, B=panel_57)
edges = BrepEdges(Brep=subdmesh)  # -> Naked, Interior, NonManifold
edges_2 = BrepEdges(Brep=subdmesh_2)  # -> Naked, Interior, NonManifold
panel_58 = Panel(division_3)
panel_59 = Panel(division_4)
crv = Curve(edges.Naked)
crv_2 = Curve(edges_2.Naked)
boundary = BoundarySurfaces(Edges=crv)  # -> flatten(Surfaces)
boundary_2 = BoundarySurfaces(Edges=crv_2)  # -> flatten(Surfaces)
area_2 = Area(Geometry=boundary)  # -> Area, Centroid
area_3 = Area(Geometry=boundary_2)  # -> Area, Centroid
ma = MassAddition(Input=flatten(area_2.Area))  # -> Result, PartialResults
ma_2 = MassAddition(Input=flatten(area_3.Area))  # -> Result, PartialResults
addition_3 = Addition(A=ma.Result, B=ma_2.Result)

# ----
# 眩光模拟
panel_60 = Panel("Glare")
model_3 = HBModel(rooms=flatten(applymodset), name=panel_60)  # -> report, model; plug-in component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
radialgridrooms = HBRadialGridFromRooms(rooms=applymodset, grid_size="2")  # -> grid, points, vecs, mesh; plug-in component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
assigngridsviews_3 = HBAssignGridsAndViews(model=model_3.model, grids=flatten(radialgridrooms.grid))  # -> model; plug-in component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

# ----
# 建筑表面太阳辐射量可视化
number_slider_12 = Slider(1200, range=0..10000)
legendpar_3 = LBLegendParameters(min=Slider(0, range=0..100), max=number_slider_12)  # -> leg_par; plug-in component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
heatmap = LBSpatialHeatmap(values=flatten(cumulativeradiation.radiation), mesh=mjoin, legend_par=legendpar_3, legend_title="Radiation")  # -> mesh, legend, title, colors, legend_par, vis_set; disabled; plug-in component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

annualglare = HBImagelessAnnualGlare(model=assigngridsviews_3, wea=wea, schedule=item_6, run=S.e)  # -> report, results, GA; plug-in component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
annualdaylight = HBAnnualDaylight(model=assigngridsviews, wea=wea, schedule=item_6, enhanced=Toggle(True), run=S.d)  # -> report, results, DA, cDA, UDI, UDI_low, UDI_up; plug-in component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

# ----
# 照明时间表（接采光模拟）
# 负载强度设置
# 时间表设置
toggle_4 = BooleanToggle(True)
daylightschedule = HBDaylightControlSchedule(results=flatten(annualdaylight.results), base_schedule=weeklyschedule.schedule, ill_setpoint=250, off_at_min=toggle_4)  # -> schedules; plug-in component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
applyroomsch = HBApplyRoomSchedules(
    room_or_program=flatten(applymodset),
    occupancy_sch=weeklyschedule_10.schedule,
    activity_sch=weeklyschedule_7.schedule,
    lighting_sch=daylightschedule,
    electric_equip_sch=weeklyschedule_11.schedule,
    ventilation_sch=weeklyschedule_9.schedule,
    heating_setpt_sch=weeklyschedule_13.schedule,
    cooling_setpt_sch=weeklyschedule_12.schedule)  # -> report, mod_obj; plug-in component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
applyroomsch_2 = HBApplyRoomSchedules(
    room_or_program=flatten(applymodset),
    occupancy_sch=weeklyschedule_3.schedule,
    activity_sch=weeklyschedule_7.schedule,
    lighting_sch=daylightschedule,
    electric_equip_sch=weeklyschedule_4.schedule,
    ventilation_sch=weeklyschedule_2.schedule,
    heating_setpt_sch=weeklyschedule_6.schedule,
    cooling_setpt_sch=weeklyschedule_5.schedule)  # -> report, mod_obj; plug-in component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
applyloadvals = HBApplyLoadValues(
    room_or_program=flatten(applyroomsch_2.mod_obj),
    people_per_floor="0.1",
    lighting_per_floor="8",
    electric_per_floor="15",
    infilt_per_exterior="0.0003",
    vent_per_floor="0",
    vent_per_person="0.008333333")  # -> report, mod_obj; plug-in component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
applyloadvals_2 = HBApplyLoadValues(
    room_or_program=flatten(applyroomsch.mod_obj),
    people_per_floor="0.04",
    lighting_per_floor="6",
    electric_per_floor="15",
    infilt_per_exterior="0.0003",
    vent_per_floor="0",
    vent_per_person="0.008333333")  # -> report, mod_obj; plug-in component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
entwine = Entwine(Branch00=applyloadvals.mod_obj, Branch01=applyloadvals_2.mod_obj, FlattenInputs=True)
panel_61 = Panel("""{0;0}
{0;1}""")
item_7 = ListItem(List=panel_61, Index=number_slider, Wrap=True)
branch = TreeBranch(Tree=entwine, Path=item_7, MaintainPaths=True)

# ----
# 可视化传感器逐时照度
data = Data(annualdaylight.results)
pt = Point(gridrooms.points)
bang_2 = ExplodeTree(Data=pt)  # -> Branch0, Branch1, Branch2, Branch3
item_8 = ListItem(List=bang_2.Branch0, Index=Slider(44, range=0..100), Wrap=True)
sph = Sphere(Base=item_8, Radius="0.5")
annualtodata = HBAnnualResultsToData(results=flatten(data), sel_pts=flatten(item_8), all_pts=pt)  # -> report, data; disabled; plug-in component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
legendpar_4 = LBLegendParameters(min=Slider(0, range=0..100), max=Slider(503, range=0..1000), num_decimals="0")  # -> leg_par; plug-in component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
hourlyplot = LBHourlyPlot(data=annualtodata.data, base_pt="50,0,0", legend_par=legendpar_4)  # -> report, mesh, legend, borders, labels, title, vis_set; plug-in component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

# ----
# 可视化传感器逐时眩光DGP
pt_2 = Point(radialgridrooms.points)
vec = Vector(radialgridrooms.vecs)
data_2 = Data(annualglare.results)
bang_3 = ExplodeTree(Data=pt_2)  # -> Branch0, Branch1, Branch2, Branch3
bang_4 = ExplodeTree(Data=vec)  # -> Branch0, Branch1, Branch2, Branch3
multiplication = Multiplication(A=Slider(85, range=0..100), B=8)
item_9 = ListItem(List=bang_3.Branch3, Index=multiplication, Wrap=True)
item_10 = ListItem(List=bang_4.Branch3, Index=multiplication, Wrap=True)
annualtodata_2 = HBAnnualResultsToData(results=flatten(data_2), sel_pts=flatten(item_9), all_pts=pt_2, sel_vecs=flatten(item_10), all_vecs=vec)  # -> report, data; disabled; plug-in component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
vdis = VectorDisplay(Anchor=item_9, Vector=item_10)
panel_62 = Panel("""Night
Imperceptable Glare
Perceptable Glare
Disturbing Glare
Intolerable Glare""")
panel_63 = Panel("""0.01
0.35
0.4
0.45""")
col = Colour([ColourSwatch(SwatchColor=RGB(219, 215, 215)), ColourSwatch(SwatchColor=RGB(69, 173, 101)), ColourSwatch(SwatchColor=RGB(255, 255, 0)), ColourSwatch(SwatchColor=RGB(255, 162, 0)), ColourSwatch(SwatchColor=RGB(255, 0, 0))])
legendparcategorized = LBLegendParametersCategorized(domain=panel_63, colors=col, categories=panel_62)  # -> leg_par; plug-in component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
hourlyplot_2 = LBHourlyPlot(data=annualtodata_2.data, base_pt="50,0,0", legend_par=legendparcategorized)  # -> report, mesh, legend, borders, labels, title, vis_set; plug-in component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

mjoin_2 = MeshJoin(Meshes=radialgridrooms.mesh)
data_3 = Data(flatten(annualglare.GA))
heatmap_2 = LBSpatialHeatmap(values=data_3, mesh=mjoin_2, legend_par=legendpar_2, legend_title="%", global_title="Glare Autonomy")  # -> mesh, legend, title, colors, legend_par, vis_set; plug-in component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

# ----
# 计算采光sDA
sda = HBSpatialDaylightAutonomy(DA=annualdaylight.DA)  # -> report, sDA, pass_fail; plug-in component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
panel_64 = Panel(sda.sDA)

# ----
# 计算眩光sGA
glaremetrics = HBAnnualGlareMetrics(results=annualglare.results, occ_sch=item_6, glare_thresh=Slider(0.4, range=0..1))  # -> report, GA, sGA, pass_fail; plug-in component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
panel_65 = Panel(glaremetrics.sGA)

# ----
# 输出采光DA热图
mjoin_3 = MeshJoin(Meshes=gridrooms.mesh)
data_4 = Data(flatten(annualdaylight.DA))
heatmap_3 = LBSpatialHeatmap(values=data_4, mesh=mjoin_3, legend_par=legendpar, legend_title="%")  # -> mesh, legend, title, colors, legend_par, vis_set; disabled; plug-in component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

# ----
# HVAC设置
toggle_5 = BooleanToggle(True)
idealair = HBIdealAir(
    rooms=flatten(branch),
    economizer="NoEconomizer",
    dcv=toggle_5,
    sensible_hr="0.81",
    latent_hr="0.75",
    heat_limit="NoLimit",
    cool_limit="NoLimit")  # -> report, rooms; plug-in component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

# ----
# 验证模型性质
roomenergyattr = HBRoomEnergyAttributes({"Program": "properties.energy.program_type.display_name", "Construction Set": "properties.energy.construction_set.display_name", "Is Conditioned": "properties.energy.is_conditioned", "People per Area [ppl/m2]": "properties.energy.people.people_per_area", "Area per Person [m2/ppl]": "properties.energy.people.area_per_person", "Lighting per Area [W/m2]": "properties.energy.lighting.watts_per_area", "Electric Equipment per Area [W/m2]": "properties.energy.electric_equipment.watts_per_area", "Gas Equipment per Area [W/m2]": "properties.energy.gas_equipment.watts_per_area", "Infiltration per Exterior Area [m3/s-m2]": "properties.energy.infiltration.flow_per_exterior_area", "Ventilation per Person [m3/s-ppl]": "properties.energy.ventilation.flow_per_person"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}, selected="Lighting Schedule": "properties.energy.lighting.schedule.display_name")
faceenergyattr = HBFaceEnergyAttributes({"Construction": "properties.energy.construction.display_name", "Materials": "properties.energy.construction.layers", "Thickness [m]": "properties.energy.construction.thickness", "Density [kg/m2]": "properties.energy.construction.mass_area_density", "Heat Capacity [J/K-m2]": "properties.energy.construction.area_heat_capacity", "Construction R-Value [m2-K/W]": "properties.energy.construction.r_value", "Construction U-Value [W/m2-K]": "properties.energy.construction.u_value", "Construction U-Factor [W/m2-K]": "properties.energy.construction.u_factor", "Construction SHGC [Unshaded]": "properties.energy.construction.shgc", "R-Factor [m2-K/W]": "properties.energy.r_factor", "U-Factor [W/m2-K]": "properties.energy.u_factor", "SHGC [Unshaded]": "properties.energy.shgc", "Solar Transmitance [Unshaded]": "properties.energy.construction.solar_transmittance", "Visible Transmitance [Unshaded]": "properties.energy.construction.visible_transmittance", "Solar Reflectance [Outside]": "properties.energy.construction.outside_solar_reflectance", "Solar Reflectance [Inside]": "properties.energy.construction.inside_solar_reflectance", "Fraction Area Operable": "properties.energy.vent_opening.fraction_area_operable", "Fraction Height Operable": "properties.energy.vent_opening.fraction_height_operable", "Discharge Coefficient": "properties.energy.vent_opening.discharge_coefficient"}, selected="Visible Transmitance [Unshaded]")
faceenergyattr_2 = HBFaceEnergyAttributes({"Construction": "properties.energy.construction.display_name", "Materials": "properties.energy.construction.layers", "R-Value": "properties.energy.construction.r_value", "U-Value": "properties.energy.construction.u_value", "U-Factor": "properties.energy.construction.u_factor", "Solar Transmitance [Unshaded]": "properties.energy.construction.solar_transmittance", "Solar Reflectance [Outside]": "properties.energy.construction.outside_solar_reflectance", "Solar Reflectance [Inside]": "properties.energy.construction.inside_solar_reflectance"}, selected="U-Factor")
faceradianceattr = HBFaceRadianceAttributes({"Modifier": "properties.radiance.modifier.display_name", "Average Reflectance": "properties.radiance.modifier.average_reflectance", "Average Transmittance": "properties.radiance.modifier.average_transmittance", "Modifier Blk": "properties.radiance.modifier_blk.display_name", "Is Opaque": "properties.radiance.is_opaque", "Dynamic Group": "properties.radiance.dynamic_group_identifier", "State Count": "properties.radiance.state_count", "States": "properties.radiance.states"}, selected="States")
faceradianceattr_2 = HBFaceRadianceAttributes({"Modifier": "properties.radiance.modifier.display_name", "Average Reflectance": "properties.radiance.modifier.average_reflectance", "Average Transmittance": "properties.radiance.modifier.average_transmittance", "Modifier Blk": "properties.radiance.modifier_blk.display_name", "Is Opaque": "properties.radiance.is_opaque", "Dynamic Group": "properties.radiance.dynamic_group_identifier", "State Count": "properties.radiance.state_count", "States": "properties.radiance.states"}, selected="Average Reflectance")
faceattr = HBFaceAttributes({"Display Name": "display_name", "Simulation Name (Identifier)": "identifier", "Boundary Condition": "boundary_condition", "Has Parent": "has_parent", "Parent": "parent", "Azimuth": "azimuth", "Altitude": "altitude", "Area": "area", "Perimeter": "perimeter", "Face Type": "type", "Aperture Is Operable": "is_operable", "Door Is Glass": "is_glass"}, selected="Display Name")
lablefaces = HBLabelFaces(hb_objs=flatten(idealair.rooms), attribute=faceattr, sub_faces=Toggle(False))  # -> label_text, base_pts, labels, wire_frame; disabled; plug-in component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
colorroomattr = HBColorRoomAttributes(rooms_model=flatten(idealair.rooms), attribute=roomenergyattr)  # -> mesh, legend, wire_frame, values, colors, vis_set; disabled; plug-in component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
colorfaceattr = HBColorFaceAttributes(hb_objs=flatten(idealair.rooms), attribute=faceenergyattr_2)  # -> mesh, legend, wire_frame, values, colors, vis_set; disabled; plug-in component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

# ----
# 输出采光UDI热图
data_5 = Data(flatten(annualdaylight.UDI_up))
data_6 = Data(flatten(annualdaylight.UDI))
data_7 = Data(flatten(annualdaylight.UDI_low))
heatmap_4 = LBSpatialHeatmap(values=data_6, mesh=mjoin_3, offset_dom=number_slider_6, legend_par=legendpar, legend_title="%")  # -> mesh, legend, title, colors, legend_par, vis_set; disabled; plug-in component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
heatmap_5 = LBSpatialHeatmap(values=data_7, mesh=mjoin_3, offset_dom=number_slider_6, legend_par=legendpar, legend_title="%")  # -> mesh, legend, title, colors, legend_par, vis_set; disabled; plug-in component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
heatmap_6 = LBSpatialHeatmap(values=data_5, mesh=mjoin_3, offset_dom=number_slider_6, legend_par=legendpar, legend_title="%")  # -> mesh, legend, title, colors, legend_par, vis_set; disabled; plug-in component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

# ----
# 能耗模拟
simoutput = HBSimulationOutput(zone_energy_use=toggle_3, comfort_metrics=toggle_3)  # -> report, sim_output; plug-in component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
model_4 = HBModel(rooms=flatten(idealair.rooms))  # -> report, model; plug-in component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
simpar = HBSimulationParameter(output=simoutput.sim_output, timestep=6)  # -> sim_par; plug-in component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
modeltoosm = HBModelToOSM(model=model_4.model, epw_file=item_3, sim_par=simpar, write=S.a, run=S.a)  # -> report, jsons, osw, osm, idf, sql, zsz, rdd, html; plug-in component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

multiplication_2 = Multiplication(A=S_8.new_PCE, B=100)
multiplication_3 = Multiplication(A=S_8.new_PCE, B=100)

# ----
# 逐时能耗
roomenergyresult = HBReadRoomEnergyResult(sql=modeltoosm.sql)  # -> cooling, heating, lighting, electric_equip, gas_equip, process, hot_water, fan_electric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; disabled; plug-in component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
normbyflr = HBNormalizeByFloorArea(data=roomenergyresult.cooling, model=model_4.model)  # -> total_data, room_data; disabled; plug-in component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
hourlyplot_3 = LBHourlyPlot(data=normbyflr.room_data)  # -> report, mesh, legend, borders, labels, title, vis_set; disabled; plug-in component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

# ----
# 热舒适性PMV
roomcomfortresult = HBReadRoomComfortResult(sql=modeltoosm.sql)  # -> oper_temp, air_temp, rad_temp, rel_humidity, unmet_heat, unmet_cool; plug-in component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
legendpar_5 = LBLegendParameters(min=Slider(0, range=0..100), max=Slider(550, range=0..1000))  # -> leg_par; plug-in component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
schtodata = HBScheduleToData(schedule=item_6)  # -> data; plug-in component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
strategies = LBPassiveStrategies({"Evaporative Cooling", "Mass + Night Vent", "Occupant Use of Fans", "Capture Internal Heat", "Passive Solar Heating"}, selected="Occupant Use of Fans")
psychrometricchart = LBPsychrometricChart(
    temperature=roomcomfortresult.oper_temp,
    rel_humidity=roomcomfortresult.rel_humidity,
    base_pt="40, -150, 0",
    legend_par=legendpar_5,
    data=schtodata,
    statement="a > 0.1")  # -> report, title, temp_lines, rh_lines, hr_lines, enth_wb_lines, mesh, legend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; plug-in component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
# 舒适性评价
pmv_polygon = LBPMVPolygon(
    psych_chart=psychrometricchart.psych_chart,
    clothing=[Slider(0.7, range=0..1), Slider(0.36, range=0..1), Slider(1.36, range=0..10)],
    strategies=strategies)  # -> report, total_comfort, total_comf_data, polygon_names, polygon_comfort, polygon_data, comfort_poly, strategy_poly; plug-in component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
division_5 = Division(A=pmv_polygon.total_comfort, B=100)
total_comfort_time = Panel(division_5)

# ----
# 逐时温度
number_slider_13 = Slider(20, range=0..100)  # disabled
number_slider_14 = Slider(29, range=0..100)  # disabled
panel_66 = Panel("600, 300, 0")  # disabled
legendpar_6 = LBLegendParameters(min=number_slider_13, max=number_slider_14)  # -> leg_par; disabled; plug-in component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
hourlyplot_4 = LBHourlyPlot(
    data=flatten([roomcomfortresult.unmet_cool, roomcomfortresult.air_temp, roomcomfortresult.oper_temp]),
    base_pt=panel_66,
    legend_par=legendpar_6)  # -> report, mesh, legend, borders, labels, title, vis_set; disabled; plug-in component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

# ----
# 需选取合适设计目标与基因输入
one_over_x_2 = OneOverX(Value=division_5)
one_over_x_3 = OneOverX(Value=sda.sDA)
one_over_x_4 = OneOverX(Value=glaremetrics.sGA)
wlc_maximise_sda = Number(one_over_x_3)
wlc_maximise_sga = Number(one_over_x_4)
wlc_maximise_tct = Number(one_over_x_2)
number_slider_15 = Slider(84, range=0..100)

# ----
# 发电计算
# 基于PVWatts发电模拟
panel_67 = Panel("0")
ccr = Slider(100, range=0..100)
ccr_2 = Slider(100, range=0..100)
simplifiedphotovoltaicsmodule = Ladybug_SimplifiedPhotovoltaicsModule(mountType=panel_67, moduleEfficiency=multiplication_2, temperatureCoefficient="-0.44", moduleActiveAreaPercent=ccr_2)  # -> readMe, PVmoduleSettings; plug-in component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
simplifiedphotovoltaicsmodule_2 = Ladybug_SimplifiedPhotovoltaicsModule(mountType=panel_67, moduleEfficiency=multiplication_3, temperatureCoefficient="-0.44", moduleActiveAreaPercent=ccr)  # -> readMe, PVmoduleSettings; plug-in component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
number_slider_16 = Slider(0.95, range=0..1)
series = Series(Start=Slider(0.34, range=0..1), Step=Slider(0, range=0..100), Count=Slider(8760, range=0..10000))  # -> simplify(Series)
photovoltaicssurface = Ladybug_PhotovoltaicsSurface(
    epwFile=item_3,
    PVsurface=graft(boundary_2),
    PVsurfacePercent=100,
    DCtoACderateFactor=number_slider_16,
    PVmoduleSettings=simplifiedphotovoltaicsmodule_2.PVmoduleSettings,
    north=0,
    albedo=series,
    runIt=S.c)  # -> readMe, port, ACenergyPerHour, ACenergyPerYear, averageDailyACenergyPerYear, port_2, DCenergyPerHour, totalRadiationPerHour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; plug-in component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
photovoltaicssurface_2 = Ladybug_PhotovoltaicsSurface(
    epwFile=item_3,
    PVsurface=graft(boundary),
    PVsurfacePercent=100,
    DCtoACderateFactor=number_slider_16,
    PVmoduleSettings=simplifiedphotovoltaicsmodule.PVmoduleSettings,
    north=0,
    albedo=series,
    runIt=S.c)  # -> readMe, port, ACenergyPerHour, ACenergyPerYear, averageDailyACenergyPerYear, port_2, DCenergyPerHour, totalRadiationPerHour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; plug-in component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
strnum = Ladybug_SeparateData(inputList=flatten(photovoltaicssurface_2.ACenergyPerHour))  # -> numbers, strings; plug-in component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
strnum_2 = Ladybug_SeparateData(inputList=flatten(photovoltaicssurface_2.totalRadiationPerHour))  # -> numbers, strings; plug-in component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
strnum_3 = Ladybug_SeparateData(inputList=flatten(photovoltaicssurface.ACenergyPerHour))  # -> numbers, strings; plug-in component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
strnum_4 = Ladybug_SeparateData(inputList=flatten(photovoltaicssurface.totalRadiationPerHour))  # -> numbers, strings; plug-in component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
number_slider_17 = Slider(1, range=0..1)
number_slider_18 = Slider(29, range=0..100)
ma_3 = MassAddition(Input=strnum_2.numbers)  # -> Result, PartialResults
ma_4 = MassAddition(Input=strnum_4.numbers)  # -> Result, PartialResults
panel_68 = Panel(ma.Result)
panel_69 = Panel(ma_2.Result)

multiplication_4 = Multiplication(A=flatten(ma_4.Result), B=flatten(area_3.Area))
multiplication_5 = Multiplication(A=flatten(ma_3.Result), B=flatten(area_2.Area))
ma_5 = MassAddition(Input=flatten(multiplication_4))  # -> Result, PartialResults
ma_6 = MassAddition(Input=flatten(multiplication_5))  # -> Result, PartialResults
division_6 = Division(A=ma_5.Result, B=ma_2.Result)
division_7 = Division(A=division_6, B=division_4)  # -> flatten(Result)
division_8 = Division(A=ma_6.Result, B=ma.Result)

division_9 = Division(A=division_8, B=division_3)  # -> flatten(Result)
division_10 = Division(A=strnum_3.numbers, B=division_7)
division_11 = Division(A=strnum.numbers, B=division_9)  # -> flatten(Result)
division_12 = Division(A=strnum_4.numbers, B=division_7)
division_13 = Division(A=strnum_2.numbers, B=division_9)
ma_7 = MassAddition(Input=division_10)  # -> Result, PartialResults
ma_8 = MassAddition(Input=division_11)  # -> Result, PartialResults
merge_4 = Merge(Data1=strnum.strings, Data2=division_11)
merge_5 = Merge(Data1=strnum_2.strings, Data2=division_13)
merge_6 = Merge(Data1=strnum_4.strings, Data2=division_12)
merge_7 = Merge(Data1=strnum_3.strings, Data2=division_10)
photovoltaicsperformancemetrics = Ladybug_PhotovoltaicsPerformanceMetrics(
    PVsurface=graft(boundary),
    PVsurfacePercent="100",
    PVmoduleSettings=simplifiedphotovoltaicsmodule.PVmoduleSettings,
    ACenergyPerHour=merge_4,
    totalRadiationPerHour=merge_5,
    cellTemperaturePerHour=photovoltaicssurface_2.cellTemperaturePerHour,
    energyCostPerKWh=number_slider_17,
    embodiedEnergyPerM2=panel_49,
    embodiedCO2PerM2=panel_50,
    lifetime=number_slider_7,
    gridEfficiency=number_slider_18,
    optimal=False,
    runIt=S.c)  # -> readMe, optimalSystemSize, port, CUFperYear, basicPRperYear, temperatureCorrectedPRperMonth, temperatureCorrectedPRperYear, port_2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; plug-in component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
photovoltaicsperformancemetrics_2 = Ladybug_PhotovoltaicsPerformanceMetrics(
    PVsurface=graft(boundary_2),
    PVsurfacePercent="100",
    PVmoduleSettings=simplifiedphotovoltaicsmodule_2.PVmoduleSettings,
    ACenergyPerHour=merge_7,
    totalRadiationPerHour=merge_6,
    cellTemperaturePerHour=photovoltaicssurface.cellTemperaturePerHour,
    energyCostPerKWh=number_slider_17,
    embodiedEnergyPerM2=panel_49,
    embodiedCO2PerM2=panel_50,
    lifetime=number_slider_7,
    gridEfficiency=number_slider_18,
    optimal=False,
    runIt=S.c)  # -> readMe, optimalSystemSize, port, CUFperYear, basicPRperYear, temperatureCorrectedPRperMonth, temperatureCorrectedPRperYear, port_2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; plug-in component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
ma_9 = MassAddition(Input=flatten(ma_7.Result))  # -> Result, PartialResults
ma_10 = MassAddition(Input=flatten(ma_8.Result))  # -> Result, PartialResults
panel_70 = Panel(ma_10.Result)
panel_71 = Panel(ma_9.Result)
division_14 = Division(A=panel_70, B=panel_68)
division_15 = Division(A=panel_71, B=panel_69)
panel_72 = Panel(division_14)
panel_73 = Panel(division_15)

multiplication_6 = Multiplication(A=flatten(photovoltaicsperformancemetrics.EROI), B=flatten(area_2.Area))
multiplication_7 = Multiplication(A=flatten(photovoltaicsperformancemetrics_2.EROI), B=flatten(area_3.Area))
ma_11 = MassAddition(Input=flatten([photovoltaicsperformancemetrics_2.embodiedCO2, photovoltaicsperformancemetrics.embodiedCO2]))  # -> Result, PartialResults
ma_12 = MassAddition(Input=flatten([multiplication_7, multiplication_6]))  # -> Result, PartialResults
addition_4 = Addition(A=ma_10.Result, B=ma_9.Result)
multiplication_8 = Multiplication(A=addition_4, B=全国电网因子)
multiplication_9 = Multiplication(A=multiplication_8, B=number_slider_7)
division_16 = Division(A=multiplication_9, B=1000)
division_17 = Division(A=ma_12.Result, B=addition_3)
division_18 = Division(A=division_16, B=ma_11.Result)
# 发电量
panel_74 = Panel(addition_4)
# EROI
panel_75 = Panel(division_17)
# GROI
panel_76 = Panel(division_18)

one_over_x_5 = OneOverX(Value=division_18)
one_over_x_6 = OneOverX(Value=division_17)
wlc_maximise_groi = Number(one_over_x_5)
wlc_maximise_eroi = Number(one_over_x_6)

# ----
# 分项计量
# 本体能耗
# COP换算
# 综合能源
eui = HBEndUseIntensity(sql=modeltoosm.sql)  # -> eui, eui_end_use, end_uses, gross_floor; plug-in component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
bang_5 = ExplodeTree(Data=graft(eui.eui_end_use))  # -> flatten(Branch0), flatten(Branch1), flatten(Branch2), flatten(Branch3)
S_12 = Script(Eh=bang_5.Branch0, Ec=bang_5.Branch1, El=bang_5.Branch2, Ee=bang_5.Branch3, Zone=number_slider_2)  # -> out, Eh, Ec, El, Ee
# ---------- S_12: Python ----------
# 引入 Grasshopper 库（如有需要）
import ghpythonlib.components as gh

# 根据 Zone 设置默认的 COPh 值
if Zone in [0, 1, 2]:
    default_COPh = 2.288045
elif Zone in [3, 4]:
    default_COPh = 2.175822
else:
    default_COPh = 3.5

# 如果 COPh 或 COPc 为空，则使用默认值
COPh = COPh if COPh is not None else default_COPh
COPc = COPc if COPc is not None else 3.5  # 可根据需求调整默认值

# 将输入变量转换为浮点数，确保计算正确
Eh = float(Eh) if Eh is not None else 0.0
Ec = float(Ec) if Ec is not None else 0.0
El = float(El) if El is not None else 0.0
Ee = float(Ee) if Ee is not None else 0.0

# 执行计算
Eh_result = Eh / COPh  # 计算后的 Eh
Ec_result = Ec / COPc  # 计算后的 Ec
El_result = El  # El 保持不变
Ee_result = Ee  # Ee 保持不变

# 输出计算结果到 Grasshopper
Eh = Eh_result  # 输出计算后的 Eh
Ec = Ec_result  # 输出计算后的 Ec
El = El_result  # 输出 El
Ee = Ee_result  # 输出 Ee
# ---------- end S_12 ----------
panel_77 = Panel(S_12.Eh)
panel_78 = Panel(S_12.Ec)
panel_79 = Panel(S_12.Ee)
panel_80 = Panel(S_12.El)
addition_5 = Addition(A=panel_77, B=panel_78, C=panel_80, D=panel_79)
panel_81 = Panel(addition_5)

division_19 = Division(A=addition_4, B=eui.gross_floor)

# ----
# 发电量
panel_82 = Panel(division_19)
subtraction_3 = Subtraction(A=addition_5, B=panel_82)
panel_83 = Panel(subtraction_3)

wlc_minimise_energy = Number(subtraction_3)
wallacei_x = WallaceiX(
    Objectives=[wlc_maximise_groi, wlc_minimise_energy, wlc_maximise_sda, wlc_maximise_eroi, wlc_maximise_tct, wlc_maximise_sga],
    allFitness="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",
    allFrontIdx="0|17;2|13;3|23;3|24;4|13;4|18;5|14;5|17;6|5;6|13;6|16;7|4;9|17;9|19;9|21;11|15;12|3;13|15;15|10;18|0;19|3;19|9;19|10;20|3;20|4;20|7;21|16;21|24;22|2;22|21;23|3;23|13;23|18;24|20;25|1;25|10;25|12;25|21;26|22;27|22;27|24;28|7;28|11;29|2;29|10;29|13;29|17;29|20;30|3;30|12;30|23;31|3;31|4;31|7;31|9;31|16;32|22;32|23;33|12;34|1;34|2;34|15;35|4;35|7;35|20;35|23;35|24;36|3;36|6;36|9;36|11;37|4;37|5;37|19;37|20;37|24;38|5;38|15;38|17;39|4;39|5;39|6;39|11",
    allGenomes="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",
    curFrontIdx="39|0;39|1;39|2;39|3;39|4;39|5;39|6;39|7;39|8;39|9;39|10;39|11;39|12;39|13;39|14;39|15;39|16;39|17;39|18;39|19;39|20;39|21;39|22;39|23;39|24",
    curFrontIdxSave="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",
    popGen="25,40",
    total="41099281",
    wlcDone=True)  # -> WallaceiGenomes, FitnessValues, Data, WPhenotypes
gdecoder = DecodeGenome(WallaceiGenome=wallacei_x.WallaceiGenomes)
one_over_x_7 = OneOverX(Value=wallacei_x.FitnessValues)
distributor = DistributeToGrid(
    FitnessValues=one_over_x_7,
    WallaceiPhenotypes=wallacei_x.WPhenotypes,
    SizeOfTheGridInTheXDirection=number_slider_15,
    SizeOfTheGridInTheYDirection=number_slider_15,
    SizeOfTheTexts=Slider(3, range=0..100),
    OutputOptions=0)  # -> DistributedFitnessValues, DistributedData, DistributedGeometries, DistributedMeshes, DistributedNumbers, GridLocations
